# Grasshopper definition 1ex_xr_assembly_firebase.ghx (Grasshopper 1.0.7)

bang = Button()
panel = Panel("Unload libraries")
unload = PythonScript(bang=bang)
# ---------- unload: Python ----------
from compas_rhino.utilities.misc import get_tolerance
from compas_rhino.utilities.misc import unload_modules

unload_modules("compas")
unload_modules("assembly_information_model")
unload_modules("collective_assembly")
unload_modules("xr_assembly")
# ---------- end unload ----------

# ----
# write to realtime database
panel_2 = Panel("""5
10
12
13""")
key = Slider(5, range=0..100)
remove = Button()
connect = BooleanToggle(False)
add = Button()
set = Button()
write = GhPythonScript(key=key, keys=panel_2, set_keys=set, add_key=add, remove_key=remove, connect=connect)  # -> out; inputs key: Int32, keys: list of Int32, add_key: Boolean, remove_key: Boolean
# ---------- write: Python ----------
import os
from compas.rpc import Proxy

if connect:
    p = Proxy('xr_assembly.firebase.realtime_database')
    p.stop_server()
    p.start_server()

if remove_key:
    p.remove_key_built(key)

if add_key:
    p.add_key_built(key)

if set_keys:
    p.set_keys_built(keys)
# ---------- end write ----------
panel_3 = Panel(write)

# ----
# from JSON
import = Button()
py = PythonScript()  # -> HERE, DATA
# ---------- py: Python ----------
import os
import getpass

username = getpass.getuser()
USER_FOLDER = os.path.abspath(os.path.join("C:/Users/", username))
DATA = os.path.abspath(os.path.join(USER_FOLDER,"workspace/projects/xr_assembly/data"))

print(username)
print(USER_FOLDER)
print(DATA)
# ---------- end py ----------
import_2 = PythonScript(DATA=py.DATA, import_from_json=import)  # -> assembly
# ---------- import_2: Python ----------
import os
from compas.datastructures.mesh import mesh_quads_to_triangles
from compas.datastructures.mesh import mesh_unify_cycles

ghComp = ghenv.Component
ghDoc = ghComp.OnPingDocument()

# the full path of the gh file
path_gh_file = ghDoc.FilePath

# extract current filename without extension
current_filename = os.path.basename(path_gh_file)
filename = os.path.splitext(current_filename)[0]

if export_to_json:

    PATH = os.path.join(DATA, filename)
    
    # the assembly has to be serialized such that it can be called from CPython
    assembly.to_json(PATH)

if export_to_json_unity:
    
    for key, e in assembly.elements():
    
        #convert to trimesh
        mesh_quads_to_triangles(e.mesh, check_angles=False)
        #mesh_unify_cycles(e._mesh)
        #print e._mesh.faces
        #print e._mesh.face_vertices(list(e._mesh.faces())[0])

    filename = 'assembly_boxes.json'
    PATH = os.path.join(DATA, filename)
    assembly.to_json(PATH)
# ---------- end import_2 ----------

# ----
# read from realtime database
connect_2 = BooleanToggle(False)
update_keys_built = Trigger(Interval=100, TimerInterval=100, Target=read)  # disabled
read = GhPythonScript(connect=connect_2)  # -> out, keys_built; inputs connect: Boolean
# ---------- read: Python ----------
import os
from compas.rpc import Proxy
    
 
if connect:
    p = Proxy('xr_assembly.firebase.realtime_database')
    
    p.stop_server()
    p.start_server()
    
    keys_built = p.get_keys_built()
    print(keys_built)
# ---------- end read ----------
panel_4 = Panel(read.keys_built)
panel_5 = Panel(read.out)

pts = Point([Point(2.065395693, 0.2617710369, 2.130041321), Point(-1.818009768, -0.6203069177, 2.155720641)])
pts_2 = Point([Point(0.8780543817, -1.747846355, 1.459727379), Point(-1.202992352, 1.530489571, 1.526744075)])
crv = Curve(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)

# ----
# Targets
count = Slider(8, range=0..10)
show = BooleanToggle(False)
qr_codes = GhPythonScript(count=count, show=show, export_to_unity=Button())  # -> out, markers, all_points, markers_origins, id; inputs count: Int32
# ---------- qr_codes: Python ----------
import rhinoscriptsyntax as rs
import Rhino.Geometry as rg

markers = []
id = []
markers_origins = []

circle = rs.AddCircle(rg.Point3d(0,0,0), 2.5)
all_points = rs.DivideCurve(circle, count)

if show:
    for i, point in enumerate(all_points):
    
       plane = rg.Plane(rg.Point3d(point[0], point[1], 0.0001), rg.Vector3d.ZAxis)
       T = rg.Transform.Translation(-0.1, -0.1, 0)
       marker_origin = rg.Point3d(point[0], point[1], 0.0001)
       marker_origin.Transform(T)
       markers_origins.append(marker_origin)
       
       marker = rg.Rectangle3d(plane, rg.Interval(-0.1, 0.1), rg.Interval(-0.1, 0.1))
       markers.append(marker)
       id.append(i)
# ---------- end qr_codes ----------
srf = Surface(qr_codes.markers)
pt = Point(qr_codes.all_points)
pt_2 = Point(qr_codes.markers_origins)
pln = Plane(qr_codes.markers_origins)
preview = CustomPreview(Geometry=srf, Shader=ColourSwatch(SwatchColor=RGB(59, 59, 59)))
tag = TextTag(Location=pt, Text=qr_codes.id)

# ----
# Element
# Visualise the defined element
show_2 = BooleanToggle(False)
pln_2 = Plane(PlaneXY(0, 0, 0))

meshbox = Mesh(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)

xr_elem = GhPythonScript(mesh=meshbox, origin=pln_2, object_type="lox")  # -> out, elem
# ---------- xr_elem: Python ----------
import math
from compas_rhino.geometry import RhinoMesh
from compas.geometry import Frame
from compas_ghpython import draw_frame

from xr_assembly.assembly import XRElement


cmesh = RhinoMesh.from_guid(mesh).to_compas()
#cmesh.cull_vertices()
print(cmesh.number_of_faces())
frame = Frame(origin.Origin, origin.XAxis, origin.YAxis)
elem = XRElement.from_mesh(cmesh, frame)

print(elem.frame)
elem.object_type = object_type
# ---------- end xr_elem ----------
draw = PythonScript(elem=xr_elem.elem, show=show_2)  # -> M, F, S, V
# ---------- draw: Python ----------
import os
from compas.geometry import Transformation
from compas.geometry import Frame
from compas.datastructures import mesh_transformed
from compas_ghpython.artists import MeshArtist
from compas_ghpython import draw_frame

V = []

if show:
    artist = MeshArtist(elem.mesh)
    M = artist.draw()
    F = draw_frame(elem.frame)
    #V.append(draw_frame(elem.voxel_a_frame))
    #V.append(draw_frame(elem.voxel_b_frame))
# ---------- end draw ----------

preview_2 = CustomPreview(Geometry=draw.M, Shader=ColourSwatch(SwatchColor=RGBA(255, 227, 227, 67)))
pln_3 = Plane(draw.V)

# ----
# Assembly
# Takes a polyline as an input to create the first layer of elements
# Firebase
transform = BooleanToggle(False)
pt_3 = Point(Point(0, 0, 0))
create_assembly = GhPythonScript(elem=xr_elem.elem, center=pt_3, curve=crv, layers_num=Slider(14, range=0..15))  # -> out, assembly, points, layer0; inputs center: Point3d, layers_num: Int32
# ---------- create_assembly: Python ----------
import Rhino.Geometry as rg
import rhinoscriptsyntax as rs
import math

from compas.geometry import Frame, Scale, Reflection
from collective_assembly.assembly import CAssembly
from collective_assembly.assembly import CElement

assembly = CAssembly()

u_dist = 0.258
v_dist = 0.2165

#u_dist = 0.252
#v_dist = 0.210

offset_ground = 0.194


planes = []
layer0 = []
v = layers_num # number of vertical layers


#########################################################################################
### CREATE PLANES FOR LAYER 0
#########################################################################################

### divide curve 
points = rs.DivideCurveLength(curve, u_dist/2. , True, True)

### add a new plane to point, y-axis along the polyline direction
for i, point in enumerate(points):
    y_axis = points[i] - points[i-1]
    z_axis = points[i] - rg.Point3d(points[i].X, points[i].Y, 1.) 
    x_axis = rs.VectorCrossProduct(z_axis, y_axis)
    planes.append(rs.CreatePlane(point, x_axis, y_axis))

### check if plane X-axis is parallel to global Y-axis
def orient_planes(planes):
    is_flipped_list = []
    for plane in planes:
        if rs.IsVectorParallelTo(plane.XAxis, rg.Vector3d.YAxis):
            plane.Rotate(math.radians(180), plane.ZAxis, plane.Origin)
            is_flipped_list.append(True)
        else:
            is_flipped_list.append(False)
    return planes, is_flipped_list

### save each forth plane in a separate list
#for plane in planes[1::4]:
#    layer0.append(plane)

for plane in planes[3::4]:
    layer0.append(plane)
    
layer0, is_flipped_list = orient_planes(layer0)
    
frames_layer0 = [Frame(plane.Origin, plane.XAxis, plane.YAxis) for plane in layer0]

#########################################################################################
### CREATE WALL FROM PLANES
#########################################################################################

#assembly.create_layer0(elem, frames_layer0, is_flipped_list, u_dist)

### create layers above first layer
assembly.create_circular_wall(frames_layer0, is_flipped_list, elem, v, u_dist, v_dist, offset_ground)

assembly.input_curve_center = center

#########################################################################################
### Scale assembly
#########################################################################################

#S = Scale.from_factors([1./scale]*3)
#R = Reflection.from_plane(([0,0,0],[1,0,0]))
#
#if transform:
#    assembly.transform(R)
#    assembly.network.transform(R)
# ---------- end create_assembly ----------
create_holes = GhPythonScript(assembly=create_assembly.assembly, pts=pts, pts_top=pts_2, transform=transform)  # -> out, assembly; inputs pts: list of Point3d, pts_top: list of Point3d
# ---------- create_holes: Python ----------
from compas.geometry import Point, Vector
import Rhino.Geometry as rg
import math

from compas.geometry import Rotation, Reflection
from compas.geometry import Plane

for pt in pts:
    # get the element closest to the point 
    key_closest = assembly.find_element_closest_to_point(Point(pt.X, pt.Y, pt.Z))
    
    # get all elements below the chosen element
    all_keys_below = assembly.get_all_neighbors_below(key_closest)
    
    # set node attribute of all chosen keys as support
    keys_support = [key_closest] + all_keys_below
    assembly.network.nodes_attribute('is_support', value=True, keys=keys_support)



for pt in pts_top:
    # get the element closest to the point 
    key_closest = assembly.find_element_closest_to_point(Point(pt.X, pt.Y, pt.Z))
    
    # get all elements above the chosen element
    all_keys_above = assembly.get_all_neighbors_above(key_closest)
    
    # set node attribute of all chosen keys as support
    keys_top = [key_closest] + all_keys_above
#    assembly.network.nodes_attribute('is_support', value=True, keys=keys_top)
#    
for key in keys_top:
    assembly.network.delete_node(key)
    
    
R = Rotation.from_axis_and_angle([0,0,1], math.radians(90), point=[0,0,0])
R1 = Reflection.from_plane(((0,0,0), [0,1,0]))

if transform:
    assembly.transform(R)
    assembly.transform(R1)
    assembly.network.transform(R)
    assembly.network.transform(R1)


#R = Rotation.from_axis_and_angle([0,0,1], math.radians(90), point=[0,0,0])
#
#R1 = Reflection.from_plane(((0,0,0), [0,1,0]))
#
#if transform:
#    assembly.transform(R)
#    assembly.transform(R1)
#    assembly.network.transform(R)
#    assembly.network.transform(R1)
# ---------- end create_holes ----------
set_phases = GhPythonScript(assembly=create_holes.assembly)  # -> out, assembly
# ---------- set_phases: Python ----------
keys_support = list(assembly.network.nodes_where({'is_support':True}))

# set phase_1 to True for all supporting elements
for key in keys_support:
    assembly.network.nodes_attribute('phase_1', value=True, keys=keys_support)

# set phase_1, phase_2 and phase_3
for key, element in assembly.elements():
    layer = assembly.network.node_attribute(key, 'idx_v')
    if layer == 0 or layer == 1:
        assembly.network.node_attribute(key, 'phase_1', True)
    elif layer < 12 and not assembly.network.node_attribute(key, 'phase_1'):
        assembly.network.node_attribute(key, 'phase_2', True)
    elif layer > 11:
        assembly.network.node_attribute(key, 'phase_3', True)
        
keys_mounted = [5,18,25,30]


for key in keys_mounted:
    assembly.network.node_attribute(key, 'is_built', True)

#for key in list(assembly.network.nodes_where({'phase_1':True})):
#    assembly.network.node_attribute(key,'is_built', True)
#
#for key in list(assembly.network.nodes_where({'phase_2':True})):
#    assembly.network.node_attribute(key,'is_built', True)
# ---------- end set_phases ----------
pt_4 = Point(create_assembly.points)
pln_4 = Plane(create_assembly.layer0)

# ----
# export locally and upload to firebase storage
panel_6 = Panel("test.json")
connect_3 = BooleanToggle(False)
export = Button()
upload = Button()
export_2 = Button()
py_2 = PythonScript()  # -> DATA; same code as py
upload_2 = PythonScript(
    DATA=py_2,
    assembly=set_phases.assembly,
    filename=panel_6,
    export_to_json=export,
    export_to_json_unity=export_2,
    upload=upload,
    connect=connect_3)  # inputs connect: Boolean
# ---------- upload_2: Python ----------
import os
from compas.datastructures.mesh import mesh_quads_to_triangles
from compas.datastructures.mesh import mesh_unify_cycles
from compas.rpc import Proxy

ghComp = ghenv.Component
ghDoc = ghComp.OnPingDocument()

# the full path of the gh file
path_gh_file = ghDoc.FilePath

# extract current filename without extension
current_filename = os.path.basename(path_gh_file)
#filename = os.path.splitext(current_filename)[0]

print(filename)
path_on_cloud = str(filename)

if export_to_json:

    PATH = os.path.join(DATA, filename)
    
    # the assembly has to be serialized such that it can be called from CPython
    assembly.to_json(PATH)

if export_to_json_unity:
    
    for key, e in assembly.elements():
    
        #convert to trimesh
        mesh_quads_to_triangles(e.mesh, check_angles=False)
        #mesh_unify_cycles(e._mesh)
        #print e._mesh.faces
        #print e._mesh.face_vertices(list(e._mesh.faces())[0])

    PATH = os.path.join(DATA, filename)
    assembly.to_json(PATH)

if connect:
    p = Proxy('xr_assembly.firebase.storage')
    p.stop_server()
    p.start_server()

if upload:
    PATH = os.path.join(DATA, filename)
    
    path_on_cloud = filename
    path_local = PATH
    
    p.upload_to_firebase(path_on_cloud, path_local)
# ---------- end upload_2 ----------

# ----
# Draw
idx = Slider(19, range=0..40)
show_3 = BooleanToggle(False)
show_4 = BooleanToggle(False)
show_5 = BooleanToggle(False)
show_6 = BooleanToggle(False)
show_7 = BooleanToggle(False)
show_8 = BooleanToggle(False)
draw_2 = PythonScript(
    assembly=set_phases.assembly,
    show_all=show_3,
    show_network=show_4,
    show_built=show_5,
    show_buildable=show_6,
    idx_selected=idx,
    show_selected=show_8,
    show_platform=show_7)  # -> G_elements_all, G_elements_structure, G_elements_support, G_nodes, G_edges, G_elements_built, G_elements_buildable, G_element_selected, planes, all_keys; inputs idx_selected: Int32, show_selected: Boolean
# ---------- draw_2: Python ----------
import os
import sys

import math
import rhinoscriptsyntax as rs
import Rhino.Geometry as rg
import ghpythonlib as gh

from compas.geometry import Vector
from compas_ghpython.artists import MeshArtist
from compas_ghpython.artists import NetworkArtist
from compas_ghpython import draw_frame

G_elements_all = []
G_elements_structure = []
G_elements_support = []
G_elements_built = []
G_elements_buildable = []
G_element_selected = []
planes = []


if show_all:
    for key, element in assembly.elements():
        artist = MeshArtist(element.mesh)
        mesh = artist.draw()
        G_elements_all.append(mesh)
        
    # elements which are part of the structure
    keys_support = list(assembly.network.nodes_where({'is_support':False}))
    for key in keys_support:
        element = assembly.element(key)
        artist = MeshArtist(element.mesh)
        mesh = artist.draw()
        G_elements_structure.append(mesh)
        planes.append(draw_frame(element.frame))
    
    # elements which are support
    keys = list(assembly.network.nodes_where({'is_support':True}))
    for key in keys:
        element = assembly.element(key)
        artist = MeshArtist(element.mesh)
        mesh = artist.draw()
        G_elements_support.append(mesh)

if show_network:
    G_nodes, G_edges = NetworkArtist(assembly.network).draw()


if show_built:
    keys = list(assembly.network.nodes_where({'is_built':True}))
    for key in keys:
        element = assembly.element(key)
        artist = MeshArtist(element.mesh)
        mesh = artist.draw()
        G_elements_built.append(mesh)

        
if show_buildable:
    keys = assembly.get_keys_buildable()
    for key in keys:
        element = assembly.element(key)
        artist = MeshArtist(element.mesh)
        mesh = artist.draw()
        G_elements_buildable.append(mesh)

if show_selected:
    element = assembly.element(idx_selected)
    artist = MeshArtist(element.mesh)
    mesh = artist.draw()
    G_element_selected=mesh

all_keys = []

for key, element in assembly.elements():
    all_keys.append(key)
# ---------- end draw_2 ----------
mesh = Mesh(draw_2.G_elements_buildable)
mesh_2 = Mesh(draw_2.G_element_selected)
pln_5 = Plane(draw_2.planes)
pt_5 = Point(draw_2.G_nodes)
mesh_3 = Mesh(draw_2.G_elements_built)
mesh_4 = Mesh(draw_2.G_elements_structure)
mesh_5 = Mesh(draw_2.G_elements_support)
line = Line(draw_2.G_edges)
mesh_6 = Mesh(draw_2.G_elements_all)
colour_swatch = ColourSwatch(SwatchColor=RGBA(209, 163, 163, 40))  # disabled
preview_3 = CustomPreview(Geometry=mesh_6, Shader=colour_swatch)
preview_4 = CustomPreview(Geometry=mesh_4, Shader=ColourSwatch(SwatchColor=RGBA(255, 156, 156, 111)))
preview_5 = CustomPreview(Geometry=mesh_3, Shader=ColourSwatch(SwatchColor=RGB(209, 105, 105)))
preview_6 = CustomPreview(Geometry=mesh, Shader=ColourSwatch(SwatchColor=RGBA(168, 163, 209, 102)))
preview_7 = CustomPreview(Geometry=mesh_5, Shader=ColourSwatch(SwatchColor=RGBA(156, 156, 156, 0)))
preview_8 = CustomPreview(Geometry=mesh_2, Shader=ColourSwatch(SwatchColor=RGB(255, 99, 99)))
preview_9 = CustomPreview(Geometry=pt_5, Shader=ColourSwatch(SwatchColor=RGB(0, 0, 0)))
tag_2 = TextTag(Location=draw_2.G_nodes, Text=draw_2.all_keys)
preview_10 = CustomPreview(Geometry=line, Shader=ColourSwatch(SwatchColor=RGB(255, 122, 122)))
