# Grasshopper definition 2ex_xr_firebase.ghx (Grasshopper 1.0.7)

# ----
# Firebase
bang = Button()
panel = Panel("Unload libraries")
unload = PythonScript(bang=bang)
# ---------- unload: Python ----------
from compas_rhino.utilities.misc import get_tolerance
from compas_rhino.utilities.misc import unload_modules

unload_modules("compas")
unload_modules("assembly_information_model")
unload_modules("xr_assembly")
# ---------- end unload ----------

# ----
# write to realtime database
panel_2 = Panel("""5
10
12
13""")
key = Slider(5, range=0..100)
remove = Button()
connect = BooleanToggle(False)
add = Button()
set = Button()
write = GhPythonScript(key=key, keys=panel_2, set_keys=set, add_key=add, remove_key=remove, connect=connect)  # -> out; inputs key: Int32, keys: list of Int32, add_key: Boolean, remove_key: Boolean
# ---------- write: Python ----------
import os
from compas.rpc import Proxy

if connect:
    p = Proxy('xr_assembly.firebase.realtime_database')
    p.stop_server()
    p.start_server()

if remove_key:
    p.remove_key_built(key)

if add_key:
    p.add_key_built(key)

if set_keys:
    p.set_keys_built(keys)
# ---------- end write ----------
panel_3 = Panel(write)

# ----
# read from realtime database
connect_2 = BooleanToggle(False)
update_keys_built = Trigger(Interval=100, TimerInterval=100, Target=read)  # disabled
read = GhPythonScript(connect=connect_2)  # -> out, keys_built; inputs connect: Boolean
# ---------- read: Python ----------
import os
from compas.rpc import Proxy
    
 
if connect:
    p = Proxy('xr_assembly.firebase.realtime_database')
    
    p.stop_server()
    p.start_server()
    
    keys_built = p.get_keys_built()
    print(keys_built)
# ---------- end read ----------
panel_4 = Panel(read.keys_built)
panel_5 = Panel(read.out)

py = PythonScript()  # -> DATA
# ---------- py: Python ----------
import os
import getpass

username = getpass.getuser()
USER_FOLDER = os.path.abspath(os.path.join("C:/Users/", username))
DATA = os.path.abspath(os.path.join(USER_FOLDER,"workspace/projects/xr_assembly/data"))

print(username)
print(USER_FOLDER)
print(DATA)
# ---------- end py ----------

# ----
# export locally and upload to firebase storage
panel_6 = Panel("xrtest.json")
connect_3 = BooleanToggle(False)
upload = Button()
upload_2 = PythonScript(DATA=py, filename=panel_6, upload=upload, connect=connect_3)  # inputs connect: Boolean
# ---------- upload_2: Python ----------
import os
from compas.datastructures.mesh import mesh_quads_to_triangles
from compas.datastructures.mesh import mesh_unify_cycles
from compas.rpc import Proxy



print(filename)
path_on_cloud = str(filename)

if connect:
    p = Proxy('xr_assembly.firebase.storage')
    p.stop_server()
    p.start_server()

if upload:
    PATH = os.path.join(DATA, filename)
    
    path_on_cloud = filename
    path_local = PATH
    
    p.upload_to_firebase(path_on_cloud, path_local)
# ---------- end upload_2 ----------
