# Grasshopper definition AIM_XRA_workshop.ghx (Grasshopper 1.0.7)

bang = Button()
panel = Panel("Unload libraries")
unload = PythonScript(bang=bang)
# ---------- unload: Python ----------
from compas_rhino.utilities.misc import get_tolerance
from compas_rhino.utilities.misc import unload_modules

unload_modules("compas")
unload_modules("assembly_information_model")
unload_modules("xr_assembly")
# ---------- end unload ----------

panel_2 = Panel("xr_assembly_workshop.json")
py = PythonScript()  # -> DATA
# ---------- py: Python ----------
import os
import getpass

username = getpass.getuser()
USER_FOLDER = os.path.abspath(os.path.join("C:/Users/", username))
DATA = os.path.abspath(os.path.join(USER_FOLDER,"workspace/projects/xr_assembly/data"))

print(username)
print(USER_FOLDER)
print(DATA)
# ---------- end py ----------

# ----
# Visualize QR marker
panel_3 = Panel("-0.1 to 0.1")
F = File("C:\Users\fabio\workspace\projects\xr_assembly\markers\qr.jpg")
rectangle = Rectangle(Plane=PlaneXY(0, 0, 0), XSize=panel_3, YSize=panel_3, Radius=0)  # -> Rectangle, Length
img = ImportImage(File=F, Rectangle=rectangle.Rectangle)

# ----
# Element
scale_factor = Panel("0.5")
elem_def = GhPythonScript(scale_factor=scale_factor)  # -> out, elem_full, elem_half
# ---------- elem_def: Python ----------
import os
import sys
import json

from compas.geometry import Frame

from assembly_information_model.assembly import Element

# dimensions full brick
width = 0.115 * scale_factor
length = 0.240 * scale_factor
height = 0.050 * scale_factor

elem_full = Element.from_dimensions(length, width, height)
elem_full.tool_frame = Frame([0, 0, height], [1, 0, 0], [0, -1, 0])

elem_half = Element.from_dimensions(length/2, width, height)
elem_half.tool_frame = Frame([0, 0, height], [1, 0, 0], [0, -1, 0])



print (width, length, height)
# ---------- end elem_def ----------

# ----
# Assembly
force_multiplier = Slider(1, range=0.1..2)
n_courses = Slider(16, range=0..20)
n_bricks = Slider(4, range=0..10)
pt = Point([Point(0.07292898719, -0.2927908377, 0.2441400297), Point(0.3119943515, -0.2702851324, 0.3484883693)])
generate_assembly = GhPythonScript(
    elem_full=elem_def.elem_full,
    elem_half=elem_def.elem_half,
    scale_factor=scale_factor,
    COURSES=n_courses,
    BRICKS_PER_COURSE=n_bricks,
    attr_pts=pt,
    attr_force=force_multiplier)  # -> assembly, COURSES; inputs COURSES: Int32, BRICKS_PER_COURSE: Int32, attr_pts: list of Point3d
# ---------- generate_assembly: Python ----------
import Rhino.Geometry as rg
import math
from scriptcontext import sticky as st


from compas.geometry import Frame
from compas.geometry import Transformation
from compas.geometry import Rotation
from compas.geometry import Translation
from compas.geometry import Point

from compas_ghpython import draw_frame

from assembly_information_model.assembly import Assembly

import Rhino.Geometry as rg



length, width, height = [elem_full._source.xsize, elem_full._source.ysize, elem_full._source.zsize]
#print(width, length, height)

MORTAR_PERPENDS = 0.025 * scale_factor


total_length = BRICKS_PER_COURSE * length + (BRICKS_PER_COURSE - 1) * MORTAR_PERPENDS
gap_even = MORTAR_PERPENDS
gap_uneven = MORTAR_PERPENDS
gap_uneven = (total_length - (BRICKS_PER_COURSE * (length)))/BRICKS_PER_COURSE


assembly = Assembly() # initialize an empty assembly class
planes = [] # just for vizualisation


for course in range(COURSES):
    dy = course * height
    half_brick_ends = course % 2 != 0
    gap = gap_even if course % 2 == 0 else gap_uneven
    dx = 0

    bricks_in_course = BRICKS_PER_COURSE + (1 if half_brick_ends else 0)
    for j in range(bricks_in_course):

        first = j == 0
        last = j == bricks_in_course - 1

        is_half_brick = (first or last) and half_brick_ends

        if is_half_brick:
            if last:
                T = Translation.from_vector([dx - width/2, 0, dy])
            else:
                T = Translation.from_vector([dx - width/2-gap/2, 0, dy])
            e = elem_half.transformed(T)
            dx += width+gap/2
        else:
            T = Translation.from_vector([dx, 0, dy])
            e = elem_full.transformed(T)
            dx += length
        
        cpt = e.frame.point
        
        #apply rotation to the bricks according to the distance of the attractor points
        min_dist = 10
        for attr_pt in attr_pts:
            dist =  attr_pt.DistanceTo(rg.Point3d(cpt.x, cpt.y, cpt.z))
            if dist<min_dist:
                min_dist = dist
            #print dist
        dist = min_dist
        dist *= (1/attr_force)
        R = Rotation.from_axis_and_angle([0,0,1], math.radians(1/(0.3*dist*dist)), point=e.frame.point) 
        e.transform(R)
        
        planes.append(draw_frame(e.tool_frame)) #only for visualizing in gh
        
        typology = "half" if is_half_brick else "full"
        assembly.add_element(e, course=course, typology=typology)
        dx += gap
# ---------- end generate_assembly ----------

# ----
# write to realtime database
panel_4 = Panel("""0
6
9""")
key = Slider(0, range=0..50)
list = ValueList({"Single Key": 0, "Multiple Keys": 1}, selected="Single Key")
connect = BooleanToggle(True)
remove = Button()
add = Button()
write = GhPythonScript(write_input=list, key=key, keys=panel_4, add_key=add, remove_key=remove, connect=connect)  # -> out; inputs key: Int32, keys: list of Int32, add_key: Boolean, remove_key: Boolean
# ---------- write: Python ----------
import os
from compas.rpc import Proxy

if connect:
    p = Proxy('xr_assembly.firebase.realtime_database')
    p.stop_server()
    p.start_server()

if remove_key:
    if write_input == 0:
        p.remove_key_built(key)
    elif write_input == 1:
        for key in keys:
            p.remove_key_built(key)

if add_key:
    if write_input == 0:
        p.add_key_built(key)
    elif write_input == 1:
        for key in keys:
            p.add_key_built(key)
# ---------- end write ----------
panel_5 = Panel(write)

# ----
# read from realtime database
connect_2 = BooleanToggle(False)
update_keys_built = Trigger(Interval=100, TimerInterval=100, Target=read)
read = GhPythonScript(connect=connect_2)  # -> out, keys_built; inputs connect: Boolean
# ---------- read: Python ----------
import os
from compas.rpc import Proxy
    
 
if connect:
    p = Proxy('xr_assembly.firebase.realtime_database')
    
    p.stop_server()
    p.start_server()
    
    keys_built = p.get_keys_built()
    print(keys_built)
# ---------- end read ----------
panel_6 = Panel(read.keys_built)
panel_7 = Panel(read.out)

# ----
# upload .json to firebase storage
connect_3 = BooleanToggle(True)
# Firebase
upload = Button()
upload_2 = PythonScript(DATA=py, filename=panel_2, upload=upload, connect=connect_3)  # inputs connect: Boolean
# ---------- upload_2: Python ----------
import os
from compas.datastructures.mesh import mesh_quads_to_triangles
from compas.datastructures.mesh import mesh_unify_cycles
from compas.rpc import Proxy



print(filename)
path_on_cloud = str(filename)

if connect:
    p = Proxy('xr_assembly.firebase.storage')
    p.stop_server()
    p.start_server()

if upload:
    PATH = os.path.join(DATA, filename)
    
    path_on_cloud = filename
    path_local = PATH
    
    p.upload_to_firebase(path_on_cloud, path_local)
# ---------- end upload_2 ----------

# ----
# Assembly Information Model
add_edges = PythonScript(assembly=generate_assembly.assembly, COURSES=generate_assembly.COURSES)  # -> assembly
# ---------- add_edges: Python ----------
for course in range(COURSES-1):
    curr_course = [key for key in assembly.network.nodes_where({'course': course})]
    next_course = [key for key in assembly.network.nodes_where({'course': course+1})]

    for k in range(len(curr_course)):
        if course % 2 != 0:
            if k == 0:
                assembly.add_connection(curr_course[k],next_course[k])
            elif k == (len(curr_course)-1):
                assembly.add_connection(curr_course[k],next_course[k-1])
            else: 
                assembly.add_connection(curr_course[k],next_course[k-1])
                assembly.add_connection(curr_course[k],next_course[k])
        else:
            for k in range(len(curr_course)):
                assembly.add_connection(curr_course[k],next_course[k+1])
                assembly.add_connection(curr_course[k],next_course[k])
# ---------- end add_edges ----------

# ----
# to JSON
# XR Assembly
export = PythonScript(DATA=py, filename=panel_2, assembly=add_edges)  # -> assembly
# ---------- export: Python ----------
import os
from compas.datastructures.mesh import mesh_quads_to_triangles
from xr_assembly.assembly.assembly import XRAssembly

for key, e in assembly.elements():
    #convert to trimesh
    mesh_quads_to_triangles(e._mesh, check_angles=False)

PATH = os.path.join(DATA, filename)
print(PATH)

assembly.export_to_json_for_xr(PATH)
assembly = XRAssembly.from_json(PATH)
# ---------- end export ----------

# ----
# Draw
idx = Slider(5, range=0..40)
show = BooleanToggle(False)
show_2 = BooleanToggle(True)
show_3 = BooleanToggle(True)
show_4 = BooleanToggle(False)
show_5 = BooleanToggle(False)
draw = PythonScript(
    assembly=export,
    show_all=show_3,
    show_network=show_4,
    show_built=show_2,
    show_buildable=show_5,
    idx_selected=idx,
    show_selected=show)  # -> G_elements_all, G_elements_structure, G_elements_support, G_nodes, G_edges, G_elements_built, G_elements_buildable, G_element_selected, planes, all_keys; inputs idx_selected: Int32, show_selected: Boolean
# ---------- draw: Python ----------
import os
import sys

import math
import rhinoscriptsyntax as rs
import Rhino.Geometry as rg
import ghpythonlib as gh

from compas.geometry import Vector
from compas_ghpython.artists import MeshArtist
from compas_ghpython.artists import NetworkArtist
from compas_ghpython import draw_frame

G_elements_all = []
G_elements_structure = []
G_elements_built = []
G_elements_buildable = []
G_element_selected = []
planes = []

print(assembly)

if show_all:
    for key, element in assembly.elements():
        artist = MeshArtist(element.mesh)
        mesh = artist.draw()
        G_elements_all.append(mesh)
        
    # elements which are part of the structure
    keys_support = list(assembly.network.nodes_where({'is_support':False}))
    for key in keys_support:
        element = assembly.element(key)
        artist = MeshArtist(element.mesh)
        mesh = artist.draw()
        G_elements_structure.append(mesh)
        planes.append(draw_frame(element.frame))

if show_network:
    G_nodes, G_edges = NetworkArtist(assembly.network).draw()

if show_built:
    keys = list(assembly.network.nodes_where({'is_built':True}))
    for key in keys:
        element = assembly.element(key)
        artist = MeshArtist(element.mesh)
        mesh = artist.draw()
        G_elements_built.append(mesh)

if show_buildable:
    keys = assembly.get_keys_buildable()
    for key in keys:
        element = assembly.element(key)
        artist = MeshArtist(element.mesh)
        mesh = artist.draw()
        G_elements_buildable.append(mesh)
        print assembly.element(key)

if show_selected:
    element = assembly.element(idx_selected)
    artist = MeshArtist(element.mesh)
    mesh = artist.draw()
    G_element_selected=mesh

all_keys = []

for key, element in assembly.elements():
    all_keys.append(key)
# ---------- end draw ----------
mesh = Mesh(draw.G_elements_support)
pt_2 = Point(draw.G_nodes)
mesh_2 = Mesh(draw.G_element_selected)
pln = Plane(draw.planes)
line = Line(draw.G_edges)
mesh_3 = Mesh(draw.G_elements_built)
mesh_4 = Mesh(draw.G_elements_buildable)
mesh_5 = Mesh(draw.G_elements_structure)
mesh_6 = Mesh(draw.G_elements_all)
preview = CustomPreview(Geometry=mesh_5, Shader=ColourSwatch(SwatchColor=RGBA(255, 156, 156, 111)))
preview_2 = CustomPreview(Geometry=mesh, Shader=ColourSwatch(SwatchColor=RGBA(156, 156, 156, 0)))
preview_3 = CustomPreview(Geometry=mesh_3, Shader=ColourSwatch(SwatchColor=RGB(209, 105, 105)))
preview_4 = CustomPreview(Geometry=mesh_4, Shader=ColourSwatch(SwatchColor=RGBA(168, 163, 209, 102)))
preview_5 = CustomPreview(Geometry=mesh_2, Shader=ColourSwatch(SwatchColor=RGB(255, 99, 99)))
preview_6 = CustomPreview(Geometry=mesh_6, Shader=ColourSwatch(SwatchColor=RGBA(209, 163, 163, 50)))
preview_7 = CustomPreview(Geometry=pt_2, Shader=ColourSwatch(SwatchColor=RGB(0, 0, 0)))
preview_8 = CustomPreview(Geometry=line, Shader=ColourSwatch(SwatchColor=RGB(255, 122, 122)))
tag = TextTag(Location=draw.G_nodes, Text=draw.all_keys)
